# Grasshopper definition Ring.gh (Grasshopper 1.0.7)

width = Slider(1, range=0..1)
thickness = Slider(0.25, range=0..1)

# ---- group: RH_IN:ring
number_slider = Slider(400, range=360..400)

# ---- group: RH_IN:Upper offset
number_slider_2 = Slider(29, range=-1..40)

# ---- group: RH_IN:Lower offset
number_slider_3 = Slider(-1, range=-1..30)

# ----
number_slider_4 = Slider(200, range=0..1000)
construct_domain = ConstructDomain(DomainStart=Slider(0, range=0..100), DomainEnd=number_slider)
construct_domain_2 = ConstructDomain(DomainStart=Slider(1.527, range=0..2.001), DomainEnd=Slider(2.001, range=0..2.001))
construct_domain_3 = ConstructDomain(DomainStart=number_slider_3, DomainEnd=number_slider_2)
xz_plane = XZPlane(Origin=Point(0, 0, 0))
range = Range(Domain=construct_domain_2, Steps=number_slider_4)
range_2 = Range(Domain=construct_domain, Steps=number_slider_4)
range_3 = Range(Domain=construct_domain_3, Steps=number_slider_4)
rotate_plane = RotatePlane(Plane=xz_plane, Angle=degrees(Slider(100, range=0..100)))
point_polar = PointPolar(BasePlane=rotate_plane, XYAngle=degrees(range_2), ZAngle=degrees(range_3), Offset=range)
interpolate = Interpolate(Vertices=point_polar, Degree=3, Periodic=False, KnotStyle=1)  # -> Curve, Length, Domain
construct_domain_4 = ConstructDomain(DomainStart=expr("-x/2", thickness), DomainEnd=expr("x/2", thickness))
construct_domain_5 = ConstructDomain(DomainStart=expr("-x/2", width), DomainEnd=expr("x/2", width))
perp_frame = PerpFrame(Curve=reparameterize(interpolate.Curve), Parameter=Slider(0, range=0..1))
rectangle = Rectangle(Plane=perp_frame, XSize=construct_domain_4, YSize=construct_domain_5, Radius=Slider(0.1, range=0..0.1))  # -> Rectangle, Length
sweep1 = Sweep1(Rail=interpolate.Curve, Sections=rectangle.Rectangle, Miter=1)
cap_holes = CapHoles(Brep=sweep1)
custom_preview = CustomPreview(Geometry=cap_holes, Material=ColourSwatch(SwatchColor=RGB(235, 216, 9)))
brep = Brep(cap_holes)

# ---- group: RH_OUT:mesh
mesh_brep = MeshBrep(
    Brep=brep,
    Settings={GridMaxCount=0, GridMinCount=16, JaggedSeams=False, MaxEdgeLength=0, MinEdgeLength=0.0001, MinTolerance=0, Refine=True, RefineAngle=0, RelativeTolerance=0.65, SimplePlanes=True, Tolerance=0})
