# Grasshopper definition Spheres.gh (Grasshopper 1.0.7)
# plug-ins: Exoskeleton

rectangle = Rectangle(Plane=PlaneXY(0, 0, 0), XSize=Slider(25, range=0..50), YSize=Slider(25, range=0..50), Radius=0)  # -> Rectangle, Length
mesh_sphere = MeshSphere(Base=PlaneXY(0, 0, 0), Radius=Slider(10, range=0..10), UCount=10, VCount=20)
box_rectangle = BoxRectangle(Rectangle=rectangle.Rectangle, Height=Slider(10, range=0..10))
extract_edges = ExtractEdges(M=mesh_sphere)  # -> out, L, A, B; inputs M: Mesh
# ---------- extract_edges: VB ----------
    Component.Params.Input(0).Name = "Mesh"
    Component.Params.Input(0).Description = "Open or closed mesh"

    Component.Params.Output(1).Name = "Lines"
    Component.Params.Output(1).Description = "All the edges of the mesh output at lines in topological order"
    Component.Params.Output(2).Name = "Index 1"
    Component.Params.Output(2).Description = "Index of one of the topology vertices which defines the edge"
    Component.Params.Output(3).Name = "Index 2"
    Component.Params.Output(3).Description = "Index of one of the topology vertices which defines the edge"

    If m IsNot Nothing Then
      Dim mte As Rhino.Geometry.Collections.MeshTopologyEdgeList
      Dim arrL As New list(Of line)
      Dim arrI, arrJ As New list(Of Integer)
      Dim i As Integer

      mte = M.TopologyEdges()

      For i = 0 To mte.count() - 1 Step 1
        arrL.add(mte.EdgeLine(i))
        arrI.add(mte.GetTopologyVertices(i).I)
        arrJ.add(mte.GetTopologyVertices(i).J)
      Next

      L = arrL
      A = arrI
      B = arrJ
    end if
# ---------- end extract_edges ----------
deconstruct_brep = DeconstructBrep(Brep=box_rectangle)  # -> Faces, Edges, Vertices
number_slider = Slider(0.5, range=0..1)

# ---- group: RH_IN:count
count = Slider(20, range=-1..50)

# ---- group: RH_IN:size
size = Slider(1, range=1..5)

# ----
list_item = ListItem(List=deconstruct_brep.Faces, Index=Slider(4, range=0..10), Wrap=True)
exoskeleton = Exoskeleton(
    Lines=extract_edges.L,
    Sides=Slider(3, range=0..10),
    Thickness=number_slider,
    NodeSize=number_slider,
    Knuckle=0.1,
    Spacing=Slider(1, range=0..10),
    Open=Toggle(True))
populate_2d = Populate2D(Region=list_item, Count=count, Seed=1)
quad_remesh = QuadRemesh(Mesh=exoskeleton, Settings={aqc=True, as=50, dhe=True, gci=0, null=False, pme=0, sa=0, tqc=2000})
mesh_sphere_2 = MeshSphere(Base=populate_2d, Radius=size, UCount=10, VCount=20)

# ---- group: RH_OUT:mesh
mesh = Mesh(mesh_sphere_2)
