# Grasshopper definition jewellery.gh (Grasshopper 1.0.7)

perp_frame_count = Slider(21, range=0..100)
ring_radius = Slider(34.35, range=0..100)
yz_plane = YZPlane(Origin=Point(0, 0, 0))
range = Range(Domain="360", Steps=perp_frame_count)
circle = Circle(Plane=yz_plane, Radius=ring_radius)
cull_index = CullIndex(List=range, Indices="-1", Wrap=True)
perp_frames = PerpFrames(Curve=circle, Count=perp_frame_count, Align=True)  # -> Frames, Parameters
radians = Radians(Degrees=cull_index)
multiplication = Multiplication(A=radians, B=Slider(1, range=0..10))
ellipse_radius_1 = Slider(9.534, range=0..10)
ellipse_radius_2 = Slider(21.38, range=0..100)
rotate = Rotate(Geometry=perp_frames.Frames, Angle=multiplication, Plane=perp_frames.Frames)  # -> Geometry, Transform
ellipse = Ellipse(Plane=rotate.Geometry, Radius1=ellipse_radius_1, Radius2=ellipse_radius_2)  # -> Ellipse, Focus1, Focus2
thickness = Slider(10, range=-5..10)
radius_of_thickness = Slider(0.42, range=0..1)
area = Area(Geometry=ellipse.Ellipse)  # -> Area, Centroid
scale = Scale(Geometry=ellipse.Ellipse, Center=area.Centroid, Factor=radius_of_thickness)  # -> Geometry, Transform
divide_curve = DivideCurve(Curve=scale.Geometry, Count=thickness, Kinks=False)  # -> Points, Tangents, Parameters
divide_curve_2 = DivideCurve(Curve=ellipse.Ellipse, Count=thickness, Kinks=False)  # -> Points, Tangents, Parameters
dispatch = Dispatch(List=divide_curve_2.Points, DispatchPattern=[True, False])  # -> ListA, ListB
dispatch_2 = Dispatch(List=divide_curve.Points, DispatchPattern=[True, False])  # -> ListA, ListB
weave = Weave(Pattern=[0, 1], Stream0=dispatch.ListA, Stream1=dispatch_2.ListB, NullGaps=False)
nurbs_curve = NurbsCurve(Vertices=weave, Degree=3, Periodic=invert(False))  # -> flatten(Curve), Length, Domain
loft = Loft(
    Curves=nurbs_curve.Curve,
    Options={Adjust=False, Closed=True, LoftEnds=0, LoftSimp=0, LoftType=0, Rebuild=10, Refit=0.01})
